# Grasshopper definition osmDataTestNew1.gh (Grasshopper 1.0.7)

# ----
# X. Prerequisite
# 1. Download & Import OSM data
# (better not larger than 5 mb)
# Download osm data from original source:
# https://www.openstreetmap.org/export
# 
# or other map API like:
# geojson.io, ArchiGIS... etc.
# 2. Replace the whole xml library
# Here's your defalt sys.path of GH, find
# the folder ends with "\IronPython\Lib"
# and then...
# => Close Rhino application
# => Delete the folder "\IronPython\Lib\xml"
# => copy the new xml folder into "\Lib"
# (better backup files before any replacement)
# Here's two options to get the new xml library:
# Opt1a. Use the official source to download IronPython 2.7.5 from:
# 
# https://github.com/IronLanguages/ironclad/wiki/building
# 
# after installed copy the xml folder to GH sys.path
# Opt1b. You'll also have to install an extension of "pyexpat"
# for parsing the xml data in IronPython environment:
# 
# https://fepy.svn.sourceforge.net/svnroot/fepy/trunk/lib/pyexpat.py
# 
# follow the following steps to set up the modules:
# 1. rename pyexpat.py to expat.py and copy into ".../IronPython/lib/xml/parsers"
# 2. copy ".../Python27/lib/xml/dom/expatbuilder.py" to ".../lib/xml/dom"
# 3. copy ".../Python27/lib/xml/sax/expatreader.py" to ".../lib/xml/sax"
# Opt2. Or simply copy the "xml" folders
# from my sample files into GH sys.path
# * After setups if the code still shows error
#    Repeat these steps and try again:
# 
# => Close Rhino application
# => Delete the folder "\IronPython\Lib\xml"
# => copy the new "xml" folder into "\Lib\"
ghpython_script = GhPythonScript()  # -> out
# ---------- ghpython_script: Python ----------
import sys

for path in sys.path:
    print (path)
# ---------- end ghpython_script ----------
panel = Panel(ghpython_script)
file_path = FilePath("C:\Users\204504\Downloads\map5a.osm")

# ----
# (better not select more
#  than 2 types at once)
file_path_2 = FilePath(file_path)
# (better not select more
#  than 2 types at once)
file_path_3 = FilePath(file_path)
file_path_4 = FilePath(file_path)
# (better not select more
#  than 2 types at once)
colour_swatch = ColourSwatch(SwatchColor=RGB(148, 90, 37))
value_list = ValueList({"highway", "waterway"}, selected=["highway", "waterway"])
value_list_2 = ValueList({"building", "amenity", "man_made", "brand", "commercial", "shop", "historic", "healthcare", "museum", "office", "tourism"}, selected=["building", "amenity", "man_made", "brand", "commercial", "shop", "historic", "healthcare", "museum", "office", "tourism"])
value_list_3 = ValueList({"landuse", "natural", "leisure", "sport", "place", "water"}, selected=["landuse", "natural", "leisure", "sport", "place", "water"])
lane_types = Panel("""trunk
trunk_link
primary
primary_link
secondary
secondary_link
tertiary
tertiary_link
steps
footway
cycleway
living_street
residential
service
track
construction
unclassified""")
# B. Highway
# 1. Extract Dict Data
ghpython_script_2 = GhPythonScript(filePath1=file_path_2, tagName1=value_list)  # -> simplify(out)
# ---------- ghpython_script_2: Python ----------
from __future__ import print_function, unicode_literals
import xml.sax
import codecs

class OSMHandler(xml.sax.ContentHandler):
    def __init__(self):
        self.osm_nodes = {}
        self._way = None
        self.base_pt = []

    def startElement(self, name, attrs):
        if name == "bounds":
            self.base_pt.append(float(attrs["maxlat"])/2 + float(attrs["minlat"])/2)
            self.base_pt.append(float(attrs["maxlon"])/2 + float(attrs["minlon"])/2)
            print ( {"base_pt" : self.base_pt} )
            
        if name == "node":
                self.osm_nodes[attrs["id"]] = (attrs["lat"], attrs["lon"])
        elif name == "way":
                self._way = {"id": attrs["id"], "nodes": [], "tags": {}}

        if self._way is not None:
            if name == "nd":
                self._way["nodes"].append(attrs["ref"])
            elif name == "tag":
                self._way["tags"][attrs["k"]] = attrs["v"]

    def endElement(self, name):
        if name == "way":
            if self._way["tags"].get(tagName1) is not None:
                nodes_json = ", ".join("[{0[0]}, {0[1]}]".
                format(self.osm_nodes[node_id]) for node_id in self._way["nodes"])
                
                if self._way["tags"].get("name") != None:
                    name = '"' + self._way["tags"].get("name") + '"'
                else:
                    name = None
                
                if self._way["tags"].get("highway") != None:
                    laneType = '"' + self._way["tags"].get("highway") + '"'
                else:
                    laneType = None
                
                lanes = self._way["tags"].get("lanes")

                print("\n", """ "{0:d}": {{"name": {1}, "laneType": {2}, "lanes": {3},"coord": [{4}]}} """.
                format(int(self._way["id"]), name, laneType, lanes, nodes_json))



file1 = codecs.open(filePath1, encoding='utf-8')

parser = xml.sax.make_parser()
parser.setContentHandler(OSMHandler())

parser.parse(file1)
# ---------- end ghpython_script_2 ----------
list_length = ListLength(List=ghpython_script_2)  # -> expr("(x/2)-1", flatten(Length))
selected_count = Panel(list_length)
# 1. Extract Dict Data
ghpython_script_3 = GhPythonScript(filePath1=file_path_4, tagName1=value_list_2)  # -> simplify(out)
# ---------- ghpython_script_3: Python ----------
from __future__ import print_function, unicode_literals
import xml.sax
import codecs

class OSMHandler(xml.sax.ContentHandler):
    def __init__(self):
        self.osm_nodes = {}
        self._way = None
        self.base_pt = []

    def startElement(self, name, attrs):
        if name == "bounds":
            self.base_pt.append(float(attrs["maxlat"])/2 + float(attrs["minlat"])/2)
            self.base_pt.append(float(attrs["maxlon"])/2 + float(attrs["minlon"])/2)
            print ( {"base_pt" : self.base_pt} )
            
        if name == "node":
                self.osm_nodes[attrs["id"]] = (attrs["lat"], attrs["lon"])
        elif name == "way":
                self._way = {"id": attrs["id"], "nodes": [], "tags": {}}

        if self._way is not None:
            if name == "nd":
                self._way["nodes"].append(attrs["ref"])
            elif name == "tag":
                self._way["tags"][attrs["k"]] = attrs["v"]

    def endElement(self, name):
        if name == "way":
            if self._way["tags"].get(tagName1) is not None:
                nodes_json = ", ".join("[{0[0]}, {0[1]}]".
                format(self.osm_nodes[node_id]) for node_id in self._way["nodes"])
                
                if self._way["tags"].get("name") != None:
                    name = '"' + self._way["tags"].get("name") + '"'
                else:
                    name = None
                height = self._way["tags"].get("height")

                print("\n", """ "{0:d}": {{"name": {1}, "height": {2}, "coord": [{3}]}} """.
                format(int(self._way["id"]), name , height, nodes_json))



file1 = codecs.open(filePath1, encoding='utf-8')

parser = xml.sax.make_parser()
parser.setContentHandler(OSMHandler())

parser.parse(file1)
# ---------- end ghpython_script_3 ----------
list_length_2 = ListLength(List=ghpython_script_3)  # -> expr("(x/2)-1", flatten(Length))
selected_count_2 = Panel(list_length_2)
# A. Landuse
# 1. Extract Dict Data
ghpython_script_4 = GhPythonScript(filePath1=file_path_3, tagName1=value_list_3)  # -> simplify(out)
# ---------- ghpython_script_4: Python ----------
from __future__ import print_function, unicode_literals
import xml.sax
import codecs

class OSMHandler(xml.sax.ContentHandler):
    def __init__(self):
        self.osm_nodes = {}
        self._way = None
        self.base_pt = []

    def startElement(self, name, attrs):
        if name == "bounds":
            self.base_pt.append(float(attrs["maxlat"])/2 + float(attrs["minlat"])/2)
            self.base_pt.append(float(attrs["maxlon"])/2 + float(attrs["minlon"])/2)
            print ( {"base_pt" : self.base_pt} )
            
        if name == "node":
                self.osm_nodes[attrs["id"]] = (attrs["lat"], attrs["lon"])
        elif name == "way":
                self._way = {"id": attrs["id"], "nodes": [], "tags": {}}

        if self._way is not None:
            if name == "nd":
                self._way["nodes"].append(attrs["ref"])
            elif name == "tag":
                self._way["tags"][attrs["k"]] = attrs["v"]

    def endElement(self, name):
        if name == "way":
            if self._way["tags"].get(tagName1) is not None:
                nodes_json = ", ".join("[{0[0]}, {0[1]}]".
                format(self.osm_nodes[node_id]) for node_id in self._way["nodes"])
                
                if self._way["tags"].get("name") != None:
                    name = '"' + self._way["tags"].get("name") + '"'
                else:
                    name = None

                print("\n", """ "{0:d}": {{"name": {1}, "coord": [{2}]}} """.
                format(int(self._way["id"]), name, nodes_json))



file1 = codecs.open(filePath1, encoding='utf-8')

parser = xml.sax.make_parser()
parser.setContentHandler(OSMHandler())

parser.parse(file1)
# ---------- end ghpython_script_4 ----------
list_length_3 = ListLength(List=ghpython_script_4)  # -> expr("(x/2)-1", flatten(Length))
selected_count_3 = Panel(list_length_3)
# C. Building
colour_swatch_2 = ColourSwatch(SwatchColor=RGB(50, 50, 50))
# (WIP)
colour_swatch_3 = ColourSwatch(SwatchColor=RGB(160, 255, 255))
# 2. Create GH Geometries
ghpython_script_5 = GhPythonScript(dataDict1=ghpython_script_2)  # -> out, listFailed1, idList1, nameList1, typeList1, lanesList1, crvList1; inputs dataDict1: list
# ---------- ghpython_script_5: Python ----------
import Rhino as rc
import Rhino.Geometry as geo
import rhinoscriptsyntax as rs

import json
import re

listDict1 = []; listFailed1 = [];
listFilter1 = filter(lambda x: not re.match(r'^\s*$', x), dataDict1)

# 0. Filter data to basePoint & List of Dict
dict0 = json.loads(listFilter1[0].replace("'", '"'))
lati0 = dict0.values()[0][0]; long0 = dict0.values()[0][1];
listFilter1.remove(listFilter1[0])


# 1. Create a Dictionary List
for data in listFilter1:
    try:
        data = "{" + data.replace("None", "null") + "}"
        dict = json.loads(data)
        listDict1.append(dict)
    except:
        listFailed1.append(data)

idList1 = []; nameList1 = []; crvList1 = []; typeList1 = []; lanesList1 = [];
vectAdj1 = geo.Point3d(lati0, long0, 0) - geo.Point3d(0,0,0)
srfList2= []

# 2. Get Coordinate from Dict & Draw Points & Draw Polygons
for dict in listDict1:
    nodes = dict.values()[0]["coord"]
    idList1.append(dict.keys()[0])
    nameList1.append(dict.values()[0]["name"])
    typeList1.append(dict.values()[0]["laneType"])
    lanesList1.append(dict.values()[0]["lanes"])
    ptList1 = []

    for nd in nodes:
        pt1 = geo.Point3d((nd[0]), (nd[1]), 0)
        ptList1.append(pt1*111000 - vectAdj1*111000)

    crv1 = geo.PolylineCurve(ptList1)

    crvList1.append(crv1)
# ---------- end ghpython_script_5 ----------
# 3. Set Differ Colors
ghpython_script_6 = GhPythonScript(
    typeList1=value_list,
    colorList1=[ColourSwatch(SwatchColor=RGB(251, 97, 155)), ColourSwatch(SwatchColor=RGB(224, 158, 110)), ColourSwatch(SwatchColor=RGB(255, 234, 110)), ColourSwatch(SwatchColor=RGB(255, 255, 202)), colour_swatch_3, colour_swatch_2])  # -> out, colors; inputs typeList1: list, colorList1: list
# ---------- ghpython_script_6: Python ----------
colors = []

for type in typeList1:
    if type == "trunk": colors.append(colorList1[0])
    if type == "primary": colors.append(colorList1[1])
    if type == "secondary": colors.append(colorList1[2])
    if type == "tertiary": colors.append(colorList1[3])
    if type == "waterway": colors.append(colorList1[4])
    else : colors.append(colorList1[5])
# ---------- end ghpython_script_6 ----------
# 2. Create GH Geometries
ghpython_script_7 = GhPythonScript(dataDict1=ghpython_script_4)  # -> out, listFailed1, idList1, nameList1, srfList1; inputs dataDict1: list
# ---------- ghpython_script_7: Python ----------
import Rhino as rc
import Rhino.Geometry as geo
import rhinoscriptsyntax as rs

import json
import re

listDict1 = []; listFailed1 = [];
listFilter1 = filter(lambda x: not re.match(r'^\s*$', x), dataDict1)

# 0. Filter data to basePoint & List of Dict
dict0 = json.loads(listFilter1[0].replace("'", '"'))
lati0 = dict0.values()[0][0]; long0 = dict0.values()[0][1];
listFilter1.remove(listFilter1[0])


# 1. Create a Dictionary List
for data in listFilter1:
    try:
        data = "{" + data.replace("None", "null") + "}"
        dict = json.loads(data)
        listDict1.append(dict)
    except:
        listFailed1.append(data)

idList1 = []; nameList1 = []; crvList1 = []; srfList1 = [];
vectAdj1 = geo.Point3d(lati0, long0, 0) - geo.Point3d(0,0,0)
srfList2= []

# 2. Get Coordinate from Dict & Draw Points & Draw Polygons
for dict in listDict1:
    nodes = dict.values()[0]["coord"]
    idList1.append(dict.keys()[0])
    nameList1.append(dict.values()[0]["name"])
    ptList1 = []

    for nd in nodes:
        pt1 = geo.Point3d((nd[0]), (nd[1]), 0)
        ptList1.append(pt1*111000 - vectAdj1*111000)

    crv1 = geo.PolylineCurve(ptList1)
    srf1 = geo.Brep.CreatePlanarBreps(rs.coercecurve(crv1))

    srfList1.append(srf1[0])
# ---------- end ghpython_script_7 ----------
# 2. Create GH Geometries
ghpython_script_8 = GhPythonScript(dataDict1=ghpython_script_3)  # -> out, listFailed1, idList1, nameList1, heightList1, plList1; inputs dataDict1: list
# ---------- ghpython_script_8: Python ----------
import Rhino as rc
import Rhino.Geometry as geo
import json
import re

listDict1 = []; listFailed1 = [];
listFilter1 = filter(lambda x: not re.match(r'^\s*$', x), dataDict1)

# 0. Filter data to basePoint & List of Dict
dict0 = json.loads(listFilter1[0].replace("'", '"'))
lati0 = dict0.values()[0][0]; long0 = dict0.values()[0][1];
listFilter1.remove(listFilter1[0])


# 1. Create a Dictionary List
for data in listFilter1:
    try:
        data = "{" + data.replace("None", "null") + "}"
        dict = json.loads(data)
        listDict1.append(dict)
    except:
        listFailed1.append(data)

idList1 = []; nameList1 = []; heightList1 = []; plList1 = [];
vectAdj1 = geo.Point3d(lati0, long0, 0) - geo.Point3d(0,0,0)


# 2. Get Coordinate from Dict & Draw Points & Draw Polygons
for dict in listDict1:
    nodes = dict.values()[0]["coord"]
    idList1.append(dict.keys()[0])
    nameList1.append(dict.values()[0]["name"])
    heightList1.append(dict.values()[0]["height"])
    ptList1 = []

    for nd in nodes:
        pt1 = geo.Point3d((nd[0]), (nd[1]), 0)
        ptList1.append(pt1*111000 - vectAdj1*111000)

    pl1 = geo.Polyline(ptList1)

    plList1.append(pl1)
# ---------- end ghpython_script_8 ----------
# 3. Set Differ Colors
ghpython_script_9 = GhPythonScript(
    tagName1=value_list_3,
    colorList1=[ColourSwatch(SwatchColor=RGB(255, 255, 155)), ColourSwatch(SwatchColor=RGB(80, 220, 110)), ColourSwatch(SwatchColor=RGB(110, 170, 160)), ColourSwatch(SwatchColor=RGB(210, 90, 110)), ColourSwatch(SwatchColor=RGB(190, 210, 110)), ColourSwatch(SwatchColor=RGB(160, 255, 255))])  # -> out, colors; inputs tagName1: list, colorList1: list
# ---------- ghpython_script_9: Python ----------
colors = []

for tag in tagName1:
    if tag == "landuse": colors.append(colorList1[0])
    if tag == "natural": colors.append(colorList1[1])
    if tag == "leisure": colors.append(colorList1[2])
    if tag == "sport": colors.append(colorList1[3])
    if tag == "place": colors.append(colorList1[4])
    if tag == "water": colors.append(colorList1[5])
# ---------- end ghpython_script_9 ----------
# 3. Set Differ Colors
ghpython_script_10 = GhPythonScript(
    tagName1=value_list_2,
    colorList1=[colour_swatch, ColourSwatch(SwatchColor=RGB(255, 180, 35)), ColourSwatch(SwatchColor=RGB(80, 54, 110)), ColourSwatch(SwatchColor=RGB(224, 23, 160)), ColourSwatch(SwatchColor=RGB(200, 35, 37)), ColourSwatch(SwatchColor=RGB(243, 93, 196)), ColourSwatch(SwatchColor=RGB(190, 110, 200)), ColourSwatch(SwatchColor=RGB(65, 108, 160)), ColourSwatch(SwatchColor=RGB(45, 218, 110)), ColourSwatch(SwatchColor=RGB(74, 130, 28)), ColourSwatch(SwatchColor=RGB(37, 179, 255))])  # -> out, colors; inputs tagName1: list, colorList1: list
# ---------- ghpython_script_10: Python ----------
colors = []

for tag in tagName1:
    if tag == "building": colors.append(colorList1[0])
    if tag == "amenity": colors.append(colorList1[1])
    if tag == "man_made": colors.append(colorList1[2])
    if tag == "brand": colors.append(colorList1[3])
    if tag == "commercial": colors.append(colorList1[4])
    if tag == "shop": colors.append(colorList1[5])
    if tag == "historic": colors.append(colorList1[6])
    if tag == "healthcare": colors.append(colorList1[7])
    if tag == "museum": colors.append(colorList1[8])
    if tag == "office": colors.append(colorList1[9])
    if tag == "tourism": colors.append(colorList1[10])
# ---------- end ghpython_script_10 ----------
dictionary = Panel(ghpython_script_2)
dictionary_2 = Panel(ghpython_script_4)
dictionary_3 = Panel(ghpython_script_3)
# 4. Post Processing:
#         add name tag /
#         extrude massing /
#         line width ...etc.
custom_preview = CustomPreview(Geometry=ghpython_script_5.crvList1, Material=simplify(graft(ghpython_script_6.colors)))
# 4. Post Processing:
#         add name tag /
#         extrude massing /
#         line width ...etc.
custom_preview_2 = CustomPreview(Geometry=ghpython_script_7.srfList1, Material=simplify(graft(ghpython_script_9.colors)))
# 4. Post Processing:
#         add name tag /
#         extrude massing /
#         line width ...etc.
custom_preview_3 = CustomPreview(Geometry=ghpython_script_8.plList1, Material=simplify(graft(ghpython_script_10.colors)))
id = Panel(ghpython_script_5.idList1)
id_2 = Panel(ghpython_script_7.idList1)
id_3 = Panel(ghpython_script_8.idList1)
name = Panel(ghpython_script_5.nameList1)
# D. Public Transport
name_2 = Panel(ghpython_script_7.nameList1)
name_3 = Panel(ghpython_script_8.nameList1)
lane_type = Panel(ghpython_script_5.typeList1)
height = Panel(ghpython_script_8.heightList1)
# E. Miscellaneous
# (power pole, traffic signal...etc.)
lanes = Panel(ghpython_script_5.lanesList1)
